# Grasshopper definition ananke_equilibrium_v01.gh (Grasshopper 1.0.8)

network = Network()  # -> Topology, Status; inputs Geometry: list
# ---------- network: Python ----------
#! python 3
# venv: ananke-equilibrium
"""Ananke Equilibrium / 01 Inputs / Network.

Inputs:
    Geometry (list), Kind (item), AnalysisPlane (item), Tolerance (item),
    LengthUnit (item)
Outputs:
    Topology (item), Status (text)
"""

from ananke_equilibrium.gh import build_network


result = build_network(
    Geometry,
    kind=Kind or "line",
    analysis_plane=AnalysisPlane,
    tolerance=Tolerance if Tolerance is not None else 1.0e-6,
    length_unit=LengthUnit or "m",
)
Topology = result.value
Status = "{}: {}".format(result.status.severity.upper(), result.status.message)
# ---------- end network ----------
fd = FDSolve()  # -> Case, Status
# ---------- fd: Python ----------
#! python 3
# venv: ananke-equilibrium
# requirements: numpy==2.0.2
# requirements: scipy==1.13.1
# requirements: compas==2.15.1
# requirements: compas_fd==0.5.4
"""Ananke Equilibrium / 02 Form Finding / FD Solve.

Inputs:
    Topology (item), Supports (item), Loads (item), Config (item)
Outputs:
    Case (item), Status (text)
"""

from ananke_equilibrium.gh import solve_fd


result = solve_fd(Topology, Supports, Loads, Config)
Case = result.value
Status = "{}: {}".format(result.status.severity.upper(), result.status.message)
# ---------- end fd ----------
supports = SupportSet()  # -> Supports, Status; inputs Points: list, NodeIDs: list
# ---------- supports: Python ----------
#! python 3
# venv: ananke-equilibrium
"""Ananke Equilibrium / 01 Inputs / Support Set.

Inputs:
    Topology (item), Points (list), NodeIDs (list), Mode (item),
    SnapTolerance (item)
Outputs:
    Supports (item), Status (text)
"""

from ananke_equilibrium.gh import build_support_set


result = build_support_set(
    Points,
    NodeIDs,
    topology=Topology,
    mode=Mode or "explicit",
    snap_tolerance=SnapTolerance,
)
Supports = result.value
Status = "{}: {}".format(result.status.severity.upper(), result.status.message)
# ---------- end supports ----------
tna = TNASolve()  # -> Case, Status
# ---------- tna: Python ----------
#! python 3
# venv: ananke-equilibrium
# requirements: numpy==2.0.2
# requirements: scipy==1.13.1
# requirements: compas==2.15.1
# requirements: compas_tna==0.7.0
"""Ananke Equilibrium / 02 Form Finding / TNA Solve.

Inputs:
    Topology (item), Supports (item), Loads (item), Height (item),
    Config (item)
Outputs:
    Case (item), Status (text)
"""

from ananke_equilibrium.gh import solve_tna


result = solve_tna(Topology, Supports, Loads, Height, Config)
Case = result.value
Status = "{}: {}".format(result.status.severity.upper(), result.status.message)
# ---------- end tna ----------
validate = Validate()  # -> Diagnostics, Status
# ---------- validate: Python ----------
#! python 3
# venv: ananke-equilibrium
"""Ananke Equilibrium / 03 Diagnostics / Validate.

Inputs:
    Case (item), ResidualTolerance (item), ClosureTolerance (item),
    AngleTolerance (item), PlanarityTolerance (item)
Outputs:
    Diagnostics (list), Status (text)
"""

from ananke_equilibrium.gh import validate_result


result = validate_result(
    Case,
    residual_tolerance=(
        ResidualTolerance if ResidualTolerance is not None else 1.0e-6
    ),
    closure_tolerance=(
        ClosureTolerance if ClosureTolerance is not None else 1.0e-6
    ),
    angle_tolerance=AngleTolerance if AngleTolerance is not None else 1.0,
    planarity_tolerance=(
        PlanarityTolerance if PlanarityTolerance is not None else 1.0e-6
    ),
)
Diagnostics = list(result.value or ())
Status = "{}: {}".format(result.status.severity.upper(), result.status.message)
# ---------- end validate ----------
loads = LoadCase()  # -> Loads, Status; inputs Points: list, NodeIDs: list, Vectors: list
# ---------- loads: Python ----------
#! python 3
# venv: ananke-equilibrium
"""Ananke Equilibrium / 01 Inputs / Load Case.

Inputs:
    Topology (item), Points (list), NodeIDs (list), Vectors (list),
    Distribution (item), CaseName (item), Factor (item)
Outputs:
    Loads (item), Status (text)
"""

from ananke_equilibrium.gh import build_load_case


result = build_load_case(
    Vectors,
    topology=Topology,
    points=Points,
    node_ids=NodeIDs,
    distribution=Distribution or "point",
    name=CaseName or "equilibrium",
    factor=Factor if Factor is not None else 1.0,
)
Loads = result.value
Status = "{}: {}".format(result.status.severity.upper(), result.status.message)
# ---------- end loads ----------
style = DiagramStyle()  # -> Style, Status
# ---------- style: Python ----------
#! python 3
# venv: ananke-equilibrium
"""Ananke Equilibrium / 04 Visualisation / Diagram Style.

Inputs:
    Preset (item), ForceScale (item), VectorScale (item),
    LabelDensity (item), ShowLabels (item), ShowConstruction (item)
Outputs:
    Style (item), Status (text)
"""

from ananke_equilibrium.gh import make_diagram_style


result = make_diagram_style(
    Preset or "Analysis",
    force_scale=ForceScale,
    vector_scale=VectorScale,
    label_density=LabelDensity,
    show_labels=ShowLabels,
    show_construction=ShowConstruction,
)
Style = result.value
Status = "{}: {}".format(result.status.severity.upper(), result.status.message)
# ---------- end style ----------
fd_settings = FDSettings()  # -> Config, Status
# ---------- fd_settings: Python ----------
#! python 3
# venv: ananke-equilibrium
"""Ananke Equilibrium / 02 Form Finding / FD Settings.

Inputs:
    ForceDensity (item or list)
Outputs:
    Config (item), Status (text)
"""

from ananke_equilibrium import FDConfig


Config = FDConfig(
    force_densities=ForceDensity if ForceDensity is not None else 1.0
)
Status = "OK: FD settings ready."
# ---------- end fd_settings ----------
tna_control = TNAControl()  # -> Height, Config, Status
# ---------- tna_control: Python ----------
#! python 3
# venv: ananke-equilibrium
"""Ananke Equilibrium / 02 Form Finding / TNA Control.

Inputs:
    HeightMode (item), HeightValue (item), HorizontalAlpha (item),
    HorizontalIterations (item), VerticalIterations (item),
    SolveTolerance (item)
Outputs:
    Height (item), Config (item), Status (text)
"""

from ananke_equilibrium import HeightControl
from ananke_equilibrium import TNAConfig


Height = HeightControl(
    mode=HeightMode or "Crown Height",
    value=HeightValue,
)
Config = TNAConfig(
    horizontal_alpha=(
        HorizontalAlpha if HorizontalAlpha is not None else 100.0
    ),
    horizontal_iterations=(
        HorizontalIterations if HorizontalIterations is not None else 100
    ),
    vertical_iterations=(
        VerticalIterations if VerticalIterations is not None else 100
    ),
    tolerance=SolveTolerance if SolveTolerance is not None else 1.0e-3,
)
Status = "OK: TNA height and iteration controls ready."
# ---------- end tna_control ----------
preview = PreviewPayload()  # -> Diagram, Status
# ---------- preview: Python ----------
#! python 3
# venv: ananke-equilibrium
"""Ananke Equilibrium / 04 Visualisation / Preview Payload.

Inputs:
    Case (item), Style (item), Kind (item), Dimension (item)
Outputs:
    Diagram (item), Status (text)
"""

from ananke_equilibrium.gh import build_preview_payload


result = build_preview_payload(
    Case,
    Style,
    kind=Kind or "form",
    dimension=Dimension if Dimension is not None else 3,
)
Diagram = result.value
Status = "{}: {}".format(result.status.severity.upper(), result.status.message)
# ---------- end preview ----------
